# Grasshopper definition Monkey.gh (Grasshopper 1.0.7)
# plug-ins: Monkey, Human

crv = Curve([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])
attributes = SimulationAttributes(Interval=Slider(20, range=0..100), MaxStep=Slider(200, range=0..1000))
loft = Loft(Curves=crv, Options={Adjust=False, Closed=False, LoftEnds=0, LoftSimp=0, LoftType=0, Rebuild=10, Refit=0.01})
pt = Point(Point(-7.147788484, -23.50705651, 0))
crv_2 = Curve(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)
dla = DLACrawl(Geo=loft, Point=pt, SimulationAttribute=attributes, Scale=1)
visualizer = DLAVisualzier(DLALines=dla)  # -> Parameters, Thickness
gradient = Gradient(
    LowerLimit=0,
    UpperLimit=1,
    Parameter=visualizer.Parameters,
    stops=[0: RGB(0, 98, 0), 0.25: RGB(81, 175, 17), 0.5: RGB(159, 198, 146), 0.75: RGB(170, 235, 41), 1: RGB(221, 255, 53)])
previewlw = CustomPreviewLineweights(Geometry=dla, Shader=gradient, Thickness=visualizer.Thickness, Absolute=False)
